% Simulink data dictionary Vehicle_Direction_Detection.sldd

SteeringWheel_YawDegreeInput = Simulink.Signal(StorageClass="ImportedExtern", DataType="int16", Min=-180, Max=180, Unit="deg")
Vehicle_Turn_Status = Simulink.Signal(StorageClass="Localizable", DataType="int16", Min=-180, Max=180, Unit="deg")
Right_Turn_AngularLimit = Simulink.Parameter(30, StorageClass="Const", DataType="int16", Min=-180, Max=180, Unit="deg")
Left_Turn_AngularLimit = Simulink.Parameter(-120, StorageClass="Const", DataType="int16", Min=-180, Max=180, Unit="deg")
Straight_Drive_Steering_Angle = Simulink.Parameter(0, StorageClass="Const", DataType="int16", Min=-180, Max=180, Unit="deg")
CameraInput_RoadSign = Simulink.Signal(StorageClass="ImportedExtern", DataType="boolean", Min=0, Max=1)
Vehicle_Direction_Indicator = Simulink.Signal(StorageClass="ExportToFile", DataType="boolean", Min=0, Max=1)
RightTurn_RoadSign = Simulink.Parameter(30, StorageClass="Const", DataType="int16", Min=-180, Max=180)
LeftTurn_RoadSign = Simulink.Parameter(-120, StorageClass="Const", DataType="int16", Min=-180, Max=180)
Straight_RoadSign = Simulink.Parameter(0, StorageClass="Const", DataType="int16", Min=-180, Max=180)